# Grasshopper definition 11WeaveLandscapeSketch.gh (Grasshopper 1.0.7)
# plug-ins: ScriptParasite

半径 = Slider(2700, range=0..10000)
松弛度 = Slider(0.7, range=0..1)
拟合度 = Slider(3, range=0..10)
长边六边形个数 = Slider(8, range=0..100)
圆管_方管半径 = Slider(30, range=0..100)
iscircle = BooleanToggle(True)
pt = Point(Point(192, 42, 0))
高度 = Slider(3500, range=0..10000)
data = Data(长边六边形个数)
data_2 = Data(半径)
data_3 = Data(pt)
data_4 = Data(高度)
data_5 = Data(松弛度)
data_6 = Data(拟合度)
data_7 = Data(圆管_方管半径)
data_8 = Data(iscircle)

panel = Panel("D:\软件\Rhino相关\KevinShopTest\11WeaveLandscapeSketch\component")

c_script = CSharpScript(
    datumPt=data_3,
    radius=data_2,
    height=data_4,
    slackness=data_5,
    fittingDegree=data_6,
    countOfUnit=data,
    radiusOfPipe=data_7,
    isCircle=data_8)  # -> out, A, B, C, D, E, F, AA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; inputs datumPt: Point3d, radius: Double, height: Double, slackness: Double, fittingDegree: Int32, countOfUnit: Int32, radiusOfPipe: Double, isCircle: Boolean
# ---------- c_script: C# usings ----------
using Rhino.Collections;
using Rhino.Geometry.Intersect;
# ---------- c_script: C# ----------
    if (countOfUnit < 4)
      countOfUnit = 4;

    double extensionLength = 100;
    double shortSideLength = (radius + extensionLength) * 2;
    double longSideLength = shortSideLength * Math.Tan(Math.PI / 6) * 2;
    double radiusOfHexagon = (longSideLength / countOfUnit) / 2;

    //create bottom rectangle
    Rectangle3d bottomRectangle = new Rectangle3d(new Plane(datumPt, Vector3d.XAxis, Vector3d.YAxis), new Interval(-longSideLength / 2, longSideLength / 2), new Interval(-shortSideLength / 2, shortSideLength / 2));
    //create top rectangle
    Rectangle3d topRectangle = bottomRectangle;
    topRectangle.Transform(Transform.Translation(0, 0, height));

    //create hexagon in the center of bottom rectangle
    Curve hexagon = CreatePolygon(datumPt,radiusOfHexagon, 6);

    //create the loft brep
    Brep loftBrep = CreateLoftBrep(datumPt, radius, height, slackness, fittingDegree, radiusOfHexagon, topRectangle);

    //create boundary brep of bottom rectangle
    Brep contourBrep = Brep.CreatePlanarBreps(bottomRectangle.ToNurbsCurve(), 0.1)[0];

    //explode the hexagon
    List<Curve> segmentsOfHexagon = new List<Curve>();
    segmentsOfHexagon.AddRange(((PolyCurve)hexagon).Explode());

    //initialize parameters for contour
    double contourDistance = radiusOfHexagon * Math.Sin(Math.PI / 3) * 2;
    double obliqueLength = longSideLength * Math.Cos(Math.PI / 6) + shortSideLength * Math.Cos(Math.PI / 3);
    double countOfObliqueContours = obliqueLength / contourDistance;
    double countOfHorizontalContours = countOfUnit;

    //correct the countOfObliqueContour
    if (countOfUnit%4==1.0)
    {
      countOfObliqueContours += 0.5;
    }
    else if(countOfUnit % 4==2.0)
    {
      countOfObliqueContours -= 1;
    }
    else if(countOfUnit % 4==3.0)
    {
      countOfObliqueContours -= 0.5;
    }
    //correct the countOfHorizontalContour
    if (countOfHorizontalContours%2==1.0)
    {
      countOfHorizontalContours -= 1;
    }

    //create contours in 3 directions
    List<Curve> obliqueContours1 = new List<Curve>();
    List<Curve> obliqueContours2 = new List<Curve>();
    List<Curve> horizontalContours = new List<Curve>();
    CreateContours(segmentsOfHexagon[0], segmentsOfHexagon[3], contourBrep, contourDistance, countOfObliqueContours, ref obliqueContours1);
    CreateContours(segmentsOfHexagon[1], segmentsOfHexagon[4], contourBrep, contourDistance, countOfHorizontalContours, ref horizontalContours);
    CreateContours(segmentsOfHexagon[2], segmentsOfHexagon[5], contourBrep, contourDistance, countOfObliqueContours, ref obliqueContours2);

    //correct contours
    //create bigger hexagon to trim contours
    Curve correctionHexagon = CreatePolygon(datumPt, radiusOfHexagon * 3, 6);
    Curve correctionCircle = new Circle(datumPt, radiusOfHexagon * Math.Sqrt(6) / 2).ToNurbsCurve();
    Point3d[] correctPts;
    correctionCircle.DivideByCount(12, false, out correctPts);
    for (int i = 0; i < correctPts.Length; i++)
    {
      correctPts[i].Transform(Transform.Rotation(Math.PI / 12, datumPt));
    }

    CurveIntersections intersections=Intersection.CurveCurve(obliqueContours1[0], correctionHexagon, 0.1, 0.1);

    
    //obliqueContours1.RemoveAt(0);
    //obliqueContours1.RemoveAt((int)countOfObliqueContours / 2 - 1);

    A = bottomRectangle;
    B = hexagon;
    C = loftBrep;
    D = segmentsOfHexagon;
    E = countOfObliqueContours;
    F = countOfHorizontalContours;
    AA = obliqueContours1;
    AB = horizontalContours;
    AC = obliqueContours2;
    AD = correctionHexagon;
    AE = correctionCircle;
    AF = correctPts;
    BA = intersections.Count;
    BB = obliqueContours1[0].Trim(obliqueContours1[0].Domain.Min, intersections[0].ParameterA);
    BC= obliqueContours1[0].Trim(intersections[1].ParameterA,obliqueContours1[0].Domain.Max);
    BD = intersections[1].PointA;
# ---------- c_script: C# additional code ----------
  public Curve CreatePolygon(Point3d datumPt,double span,int sides)
  {
    PolyCurve polygon = new PolyCurve();
    double anglePerSide = Math.PI * 2 / sides;
    for (int i = 0; i < sides; i++)
    {
      Point3d startPt = new Point3d(span * Math.Cos(anglePerSide * i), span * Math.Sin(anglePerSide * i), 0);
      startPt += datumPt;
      Point3d endPt = new Point3d(span * Math.Cos(anglePerSide * (i + 1)), span * Math.Sin(anglePerSide * (i + 1)), 0);
      endPt += datumPt;
      polygon.Append(new Line(startPt, endPt));
    }
    return polygon;
  }

  public Brep CreateLoftBrep(Point3d datumPt, double radius, double height, double slackness, int fittingDegree, double radiusOfHexagon, Rectangle3d topRectangle)
  {
    //create a seires of circles to loft
    List<Curve> curvesToLoft = new List<Curve>();
    for (int i = 0; i <= fittingDegree; i++)
    {
      double scaleFactor = ((radiusOfHexagon * Math.Sqrt(6) / 2) / radius) * (1 + i * slackness);
      double moveHeight = height / fittingDegree;
      Curve curveToLoft = new Circle(datumPt, radius * scaleFactor).ToNurbsCurve();
      curveToLoft.Transform(Transform.Translation(0, 0, i * moveHeight));
      curvesToLoft.Add(curveToLoft);
    }
    //add the last circle in the top rectangle without scaling
    Curve lastCurve = new Circle(datumPt, radius).ToNurbsCurve();
    lastCurve.Transform(Transform.Translation(0, 0, height));
    curvesToLoft.Add(lastCurve);

    //create loft part 1
    Brep loftBrepPart1 = Brep.CreateFromLoft(curvesToLoft, Point3d.Unset, Point3d.Unset, LoftType.Loose, false)[0];

    //create loft part 2 with boundary surface/brep
    CurveList curveList = new CurveList();
    curveList.Add(topRectangle.ToNurbsCurve());
    curveList.Add(lastCurve);
    Brep loftBrepPart2 = Brep.CreatePlanarBreps(curveList, 0.1)[0];

    Brep loftBrep = Brep.JoinBreps(new List<Brep> { loftBrepPart1, loftBrepPart2 }, 0.1)[0];

    return loftBrep;
  }

  public void CreateContours(Curve segmentOfHexagon,Curve oppositeSegment,Brep contourBrep,double contourDistance,double countOfContours,ref List<Curve> contours)
  {
    Point3d midPtOfSegment1 = segmentOfHexagon.PointAtLength(segmentOfHexagon.GetLength() / 2);
    double tOfMidPt1;
    segmentOfHexagon.ClosestPoint(midPtOfSegment1, out tOfMidPt1);
    Vector3d tangentAtMidPt1 = segmentOfHexagon.TangentAt(tOfMidPt1);
    Plane originPlane = new Plane(midPtOfSegment1, tangentAtMidPt1, Vector3d.ZAxis);

    Point3d midPtOfSegment2 = oppositeSegment.PointAt(oppositeSegment.GetLength() / 2);
    double tOfMidPt2;
    oppositeSegment.ClosestPoint(midPtOfSegment2, out tOfMidPt2);
    Vector3d tangentAtMidPt2 = oppositeSegment.TangentAt(tOfMidPt2);
    Plane oppositePlane = new Plane(midPtOfSegment2, tangentAtMidPt2, Vector3d.ZAxis);
    
    for (int i = 0; i < countOfContours/2; i++)
    {
      Plane interPlane = originPlane;
      Vector3d move = originPlane.ZAxis * contourDistance * i;
      interPlane.Transform(Transform.Translation(move));
      Curve[] interCrvs;
      Point3d[] interPts;
      Intersection.BrepPlane(contourBrep, interPlane, 0.1, out interCrvs, out interPts);
      if (interCrvs == null)
        continue;
      contours.AddRange(interCrvs);
    }

    for (int i = 0; i < countOfContours/2; i++)
    {
      Plane interPlane = oppositePlane;
      Vector3d move = oppositePlane.ZAxis * contourDistance * i;
      interPlane.Transform(Transform.Translation(move));
      Curve[] interCrvs;
      Point3d[] interPts;
      Intersection.BrepPlane(contourBrep, interPlane, 0.1, out interCrvs, out interPts);
      if (interCrvs == null)
        continue;
      contours.AddRange(interCrvs);
    }
  }
# ---------- end c_script ----------
scriptpar = ScriptParasite(Enable=Toggle(True), Folder=panel)

data_9 = Data(c_script.D)
data_10 = Data(c_script.AD)
panel_2 = Panel(c_script.E)
lng = ListLength(List=data_10)
panel_3 = Panel(data_10)
panel_4 = Panel(lng)

# ---- group: 底面、顶面矩形
addition = Addition(A=data_2, B="100")
expression = Expression(x=addition, Expression="x*tan(π/6)*2")
neg = Negative(Value=expression)
neg_2 = Negative(Value=addition)
dom = ConstructDomain(DomainStart=neg_2, DomainEnd=addition)
dom_2 = ConstructDomain(DomainStart=neg, DomainEnd=expression)
Z = UnitZ(Factor=data_4)
rectangle = Rectangle(Plane=data_3, XSize=dom_2, YSize=dom, Radius=0)  # -> Rectangle, Length
move = Move(Geometry=rectangle.Rectangle, Motion=Z)  # -> Geometry, Transform

# ---- group: 修正低端处等分点 / 修正系数（>=3）
panel_5 = Panel("3")

# ----
原曲线端点处权重 = Slider(0, range=0..1)

# ---- group: 纵向各拟合圆
division = Division(A=data_4, B=data_6)
series = Series(Start=0, Step=division, Count=expr("x+1", data_6))
P = Plane(data_3)
Z_2 = UnitZ(Factor=series)
cir = Circle(Plane=P, Radius=data_2)
move_2 = Move(Geometry=cir, Motion=Z_2)  # -> Geometry, Transform
item = ListItem(List=reverse(move_2.Geometry), Index=0, Wrap=True)
area = Area(Geometry=move_2.Geometry)  # -> Area, Centroid
series_2 = Series(Start="1", Step=data_5, Count=expr("x+1", data_6))

# ---- group: 顶面中心六边形
explode = Explode(Curve=rectangle.Rectangle, Recursive=True)  # -> Segments, Vertices
item_2 = ListItem(List=explode.Segments, Index=0, Wrap=True)
len = Length(Curve=item_2)
end = EndPoints(Curve=item_2)  # -> Start, End
division_2 = Division(A=len, B=data)
panel_6 = Panel("2")

# ---- group: 顶面中心六边形 / 六边形半径
division_3 = Division(A=division_2, B=panel_6)

# ---- group: 纵向各拟合圆 (continued)
expression_2 = Expression(x=division_3, Expression="x*(6^(1/2))/2")
division_4 = Division(A=expression_2, B=data_2)
multiplication = Multiplication(A=division_4, B=series_2)
scale = Scale(Geometry=move_2.Geometry, Center=area.Centroid, Factor=multiplication)  # -> Geometry, Transform

# ---- group: 顶面中心六边形 (continued)
polygon = Polygon(Plane=data_3, Radius=division_3, Segments=6, FilletRadius=0)  # -> Polygon, Length
explode_2 = Explode(Curve=polygon.Polygon, Recursive=True)  # -> Segments, Vertices

# ----
item_3 = ListItem(List=explode_2.Segments, Index=0, Wrap=True)  # -> Item, Item1, Item2, Item3, Item4, Item5
midpt = CurveMiddle(Curve=item_3.Item)
midpt_2 = CurveMiddle(Curve=item_3.Item1)
midpt_3 = CurveMiddle(Curve=item_3.Item2)
crv_cp = CurveClosestPoint(Point=midpt, Curve=item_3.Item3)  # -> Point, Parameter, Distance
crv_cp_2 = CurveClosestPoint(Point=midpt_2, Curve=item_3.Item4)  # -> Point, Parameter, Distance
crv_cp_3 = CurveClosestPoint(Point=midpt_3, Curve=item_3.Item5)  # -> Point, Parameter, Distance
boundary = BoundarySurfaces(Edges=rectangle.Rectangle)
vec2pt = Vector2Pt(PointA=crv_cp.Point, PointB=midpt, Unitize=False)  # -> Vector, Length
vec2pt_2 = Vector2Pt(PointA=crv_cp_2.Point, PointB=midpt_2, Unitize=False)  # -> Vector, Length
vec2pt_3 = Vector2Pt(PointA=crv_cp_3.Point, PointB=midpt_3, Unitize=False)  # -> Vector, Length
contour = Contour(Shape=boundary, Point=midpt, Direction=vec2pt.Vector, Distance=crv_cp.Distance, UseTasks=False)  # -> simplify(Contours)
contour_2 = Contour(Shape=boundary, Point=midpt_2, Direction=vec2pt_2.Vector, Distance=crv_cp_2.Distance, UseTasks=False)  # -> simplify(Contours)
contour_3 = Contour(Shape=boundary, Point=midpt_3, Direction=vec2pt_3.Vector, Distance=crv_cp_3.Distance, UseTasks=False)  # -> simplify(Contours)
merge = Merge(Data1=flatten(contour), Data2=flatten(contour_2), Data3=flatten(contour_3))

# ---- group: 修正低端处等分点
multiplication_2 = Multiplication(A=division_3, B=panel_5)
polygon_2 = Polygon(Plane=data_3, Radius=multiplication_2, Segments=6, FilletRadius=0)  # -> Polygon, Length
item_4 = ListItem(List=scale.Geometry, Index=0, Wrap=True)
ccx = CurveCurve(CurveA=merge, CurveB=item_4)  # -> flatten(Points), ParamsA, flatten(ParamsB)
shatter = Shatter(Curve=item_4, Parameters=ccx.ParamsB)

# ---- group: 修正各方向的分隔
ccx_2 = CurveCurve(CurveA=contour, CurveB=item_4)  # -> simplify(Points), ParamsA, ParamsB
lng_2 = ListLength(List=ccx_2.Points)
equals = Equality(FirstNumber=lng_2, SecondNumber="0")  # -> Equality, Inequality
dispatch = Dispatch(List=contour, DispatchPattern=equals.Inequality)  # -> ListA, ListB
clean = CleanTree(RemoveNulls=True, RemoveInvalid=True, RemoveEmpty=True, Tree=dispatch.ListA)
trim = TrimWithRegions(Curve=clean, Regions=polygon_2.Polygon)  # -> Inside, simplify(Outside)
data_11 = Data(flatten(trim.Outside))
dispatch_2 = Dispatch(List=data_11, DispatchPattern=[True, False])  # -> ListA, ListB
flip = FlipCurve(Curve=dispatch_2.ListB)  # -> Curve, Flag
weave = Weave(Pattern=[0, 1], Stream0=dispatch_2.ListA, Stream1=flip.Curve, NullGaps=False)
graft = GraftTree(Tree=weave, IncludeEmptyLists=True, IncludeNullItems=True)  # -> simplify(Tree)
data_12 = Data(ccx.Points)
crv_cp_4 = CurveClosestPoint(Point=data_12, Curve=graft)  # -> Point, Parameter, Distance
sort = SortList(Keys=crv_cp_4.Distance, ValuesA=data_12)  # -> Keys, ValuesA
item_5 = ListItem(List=sort.ValuesA, Index=0, Wrap=True)
ln = Line(StartPoint=item_5, EndPoint=data_3)
blendc = BlendCurve(CurveA=graft, CurveB=ln, BulgeA=原曲线端点处权重, BulgeB=1, Continuity=2)
merge_2 = Merge(Data1=graft, Data2=blendc)
join = JoinCurves(Curves=merge_2, Preserve=False)  # -> simplify(Curves)
merge_3 = Merge(Data1=flatten(dispatch.ListB), Data2=flatten(join))

ccx_3 = CurveCurve(CurveA=contour_2, CurveB=item_4)  # -> simplify(Points), ParamsA, ParamsB
lng_3 = ListLength(List=ccx_3.Points)
equals_2 = Equality(FirstNumber=lng_3, SecondNumber="0")  # -> Equality, Inequality
dispatch_3 = Dispatch(List=contour_2, DispatchPattern=equals_2.Inequality)  # -> ListA, ListB
clean_2 = CleanTree(RemoveNulls=True, RemoveInvalid=True, RemoveEmpty=True, Tree=dispatch_3.ListA)
trim_2 = TrimWithRegions(Curve=clean_2, Regions=polygon_2.Polygon)  # -> Inside, simplify(Outside)
data_13 = Data(flatten(trim_2.Outside))
dispatch_4 = Dispatch(List=data_13, DispatchPattern=[True, False])  # -> ListA, ListB
flip_2 = FlipCurve(Curve=dispatch_4.ListB)  # -> Curve, Flag
weave_2 = Weave(Pattern=[0, 1], Stream0=dispatch_4.ListA, Stream1=flip_2.Curve, NullGaps=False)
graft_2 = GraftTree(Tree=weave_2, IncludeEmptyLists=True, IncludeNullItems=True)  # -> simplify(Tree)
data_14 = Data(ccx.Points)
crv_cp_5 = CurveClosestPoint(Point=data_14, Curve=graft_2)  # -> Point, Parameter, Distance
sort_2 = SortList(Keys=crv_cp_5.Distance, ValuesA=data_14)  # -> Keys, ValuesA
item_6 = ListItem(List=sort_2.ValuesA, Index=0, Wrap=True)
ln_2 = Line(StartPoint=item_6, EndPoint=data_3)
blendc_2 = BlendCurve(CurveA=graft_2, CurveB=ln_2, BulgeA=原曲线端点处权重, BulgeB=1, Continuity=2)
merge_4 = Merge(Data1=graft_2, Data2=blendc_2)
join_2 = JoinCurves(Curves=merge_4, Preserve=False)  # -> simplify(Curves)
merge_5 = Merge(Data1=flatten(dispatch_3.ListB), Data2=flatten(join_2))

ccx_4 = CurveCurve(CurveA=contour_3, CurveB=item_4)  # -> simplify(Points), ParamsA, ParamsB
lng_4 = ListLength(List=ccx_4.Points)
equals_3 = Equality(FirstNumber=lng_4, SecondNumber="0")  # -> Equality, Inequality
dispatch_5 = Dispatch(List=contour_3, DispatchPattern=equals_3.Inequality)  # -> ListA, ListB
clean_3 = CleanTree(RemoveNulls=True, RemoveInvalid=True, RemoveEmpty=True, Tree=dispatch_5.ListA)
trim_3 = TrimWithRegions(Curve=clean_3, Regions=polygon_2.Polygon)  # -> Inside, simplify(Outside)
data_15 = Data(flatten(trim_3.Outside))
dispatch_6 = Dispatch(List=data_15, DispatchPattern=[True, False])  # -> ListA, ListB
flip_3 = FlipCurve(Curve=dispatch_6.ListB)  # -> Curve, Flag
weave_3 = Weave(Pattern=[0, 1], Stream0=dispatch_6.ListA, Stream1=flip_3.Curve, NullGaps=False)
graft_3 = GraftTree(Tree=weave_3, IncludeEmptyLists=True, IncludeNullItems=True)  # -> simplify(Tree)
data_16 = Data(ccx.Points)
crv_cp_6 = CurveClosestPoint(Point=data_16, Curve=graft_3)  # -> Point, Parameter, Distance
sort_3 = SortList(Keys=crv_cp_6.Distance, ValuesA=data_16)  # -> Keys, ValuesA
item_7 = ListItem(List=sort_3.ValuesA, Index=0, Wrap=True)
ln_3 = Line(StartPoint=item_7, EndPoint=data_3)
blendc_3 = BlendCurve(CurveA=graft_3, CurveB=ln_3, BulgeA=原曲线端点处权重, BulgeB=1, Continuity=2)
merge_6 = Merge(Data1=graft_3, Data2=blendc_3)
join_3 = JoinCurves(Curves=merge_6, Preserve=False)  # -> simplify(Curves)
merge_7 = Merge(Data1=flatten(dispatch_5.ListB), Data2=flatten(join_3))

# ---- group: 实体分隔线&实体
loft_opt = LoftOptions(Closed=False, Adjust=invert(False), Rebuild=0, Refit=0, Type="1")
merge_8 = Merge(Data1=flatten(item), Data2=flatten(move.Geometry))
merge_9 = Merge(Data1=flatten(scale.Geometry), Data2=flatten(item))  # -> flatten(Result)
loft = Loft(Curves=merge_9, Options=loft_opt)

# ----
boundary_2 = BoundarySurfaces(Edges=merge_8)

# ---- group: 实体分隔线&实体 (continued)
merge_10 = Merge(Data1=loft, Data2=boundary_2)
join_4 = BrepJoin(Breps=merge_10)  # -> Breps, Closed

# ---- group: 生产圆管/方管
entwine = Entwine(Branch00=merge_3, Branch01=merge_5, Branch02=merge_7, FlattenInputs=True)  # -> simplify(Result)
project = Project(Curve=entwine, Brep=join_4.Breps, Direction=Vector(0, 0, 1))  # -> simplify(Curve)
len_2 = Length(Curve=shatter)
pshift = ShiftPaths(Data=project, Offset=-1)
division_5 = Division(A=len_2, B="2")
end_2 = EndPoints(Curve=pshift)  # -> Start, End
data_17 = Data(end_2.End)
crv_cp_7 = CurveClosestPoint(Point=end_2.End, Curve=pshift)  # -> Point, Parameter, Distance
division_6 = Division(A=division_5, B="1.2")
eval = EvaluateCurve(Curve=pshift, Parameter=crv_cp_7.Parameter)  # -> Point, Tangent, Angle
pl = PlaneNormal(Origin=data_17, ZAxis=eval.Tangent)
data_18 = Data(flatten(pshift))
panel_7 = Panel("D:\软件\Rhino相关\KevinShopTest\11WeaveLandscapeSketch")
toggle = BooleanToggle(True)

# ----
min = Minimum(A=division_5, B=data_7)
min_2 = Minimum(A=division_6, B=data_7)

# ---- group: 生产圆管/方管 (continued)
neg_3 = Negative(Value=min_2)
dom_3 = ConstructDomain(DomainStart=neg_3, DomainEnd=min_2)
rectangle_2 = Rectangle(Plane=pl, XSize=dom_3, YSize=dom_3, Radius=0)  # -> simplify(flatten(Rectangle)), Length
pipe = Pipe(Curve=pshift, Radius=min, Caps=1)  # -> flatten(Pipe)

c_script_2 = CSharpScript(rails=data_18, sections=rectangle_2.Rectangle)  # -> out, A; inputs rails: list of Curve, sections: list of Curve
# ---------- c_script_2: C# ----------
    

    List<Brep> brepList = new List<Brep>();
    for (int i = 0; i < rails.Count; i++)
    {
      SweepOneRail sweepOneRail = new SweepOneRail();
      sweepOneRail.ClosedSweep = rails[i].IsClosable(0.1);
      sweepOneRail.SweepTolerance = 0.1;
      sweepOneRail.MiterType = 0;
      Brep[] sweepBrep = sweepOneRail.PerformSweep(rails[i], sections[i]);
      for (int j = 0; j < sweepBrep.Length; j++)
      {
        sweepBrep[j] = sweepBrep[j].CapPlanarHoles(0.1);
      }
      brepList.AddRange(sweepBrep);
    }
    A = brepList;
# ---------- end c_script_2 ----------
scriptpar_2 = ScriptParasite(Enable=toggle, Folder=panel_7)

# ----
filter = StreamFilter(Gate=data_8, Stream0=c_script_2.A, Stream1=pipe)

# ---- group: results
data_19 = Data(filter)
