# Grasshopper definition 13AxisNet.gh (Grasshopper 1.0.7)
# plug-ins: ScriptParasite

pt = Point(Point(3, 4, 0))
merge = Merge(Data1=Slider(6300, range=0..10000), Data2=Slider(3600, range=0..10000), Data3=Slider(5700, range=0..10000))
merge_2 = Merge(
    Data1=Slider(4800, range=0..10000),
    Data2=Slider(6900, range=0..10000),
    Data3=Slider(6000, range=0..10000),
    Data4=Slider(4200, range=0..10000))
data = Data(pt)
data_2 = Data(merge_2)
data_3 = Data(Toggle(True))
data_4 = Data(Slider(4800, range=0..10000))
data_5 = Data(Slider(300, range=0..10000))
data_6 = Data(Toggle(False))
data_7 = Data(merge)

c_script = CSharpScript(
    datumPt=data,
    sizeX=data_2,
    sizeY=data_7,
    createColumns=data_3,
    heightOfColumn=data_4,
    radiusOfColumn=data_5,
    isCircle=data_6)  # -> out, outVerticleLines, outHorizontalLines, outPts, outColumns; inputs datumPt: Point3d, sizeX: list of Double, sizeY: list of Double, createColumns: Boolean, heightOfColumn: Double, radiusOfColumn: Double, isCircle: Boolean
# ---------- c_script: C# usings ----------
using Rhino.Geometry.Intersect;
# ---------- c_script: C# ----------
    List<Curve> verticleLines = new List<Curve>();
    List<Curve> horizontalLines = new List<Curve>();
    DataTree<Point3d> centerPts = new DataTree<Point3d>();
    DataTree<Brep> columns = new DataTree<Brep>();

    double extensionLength = 1000;
    double lengthOfVLine = extensionLength * 2;
    double lengthOfHLine = extensionLength * 2;
    for (int i = 0; i < sizeX.Count; i++)
    {
      lengthOfHLine += sizeX[i];
    }
    for (int i = 0; i < sizeY.Count; i++)
    {
      lengthOfVLine += sizeY[i];
    }

    CreateLines(datumPt, sizeX, 0, extensionLength, lengthOfVLine, ref verticleLines);
    CreateLines(datumPt, sizeY, 1, extensionLength, lengthOfHLine, ref horizontalLines);

    if(createColumns==true)
    {
      CreateColumns(verticleLines, horizontalLines, heightOfColumn, radiusOfColumn, isCircle, ref centerPts, ref columns);
    }

    outVerticleLines = verticleLines;
    outHorizontalLines = horizontalLines;
    outPts = centerPts;
    outColumns = columns;
# ---------- c_script: C# additional code ----------
  //direction==0,create verticle lines along X axis
  //direction==1,create horizontal lines along Y axis
  public void CreateLines(Point3d datumPt,List<double> sizeList,int direction,double extensionLength,double lengthOfLine,ref List<Curve> resultLines)
  {
    for (int i = 0; i <= sizeList.Count; i++)
    {
      Point3d startPt = new Point3d(datumPt);
      double delta = extensionLength;
      int flagX = 1;
      int flagY = 0;
      for (int j = 0; j < i; j++)
      {
        delta += sizeList[j];
      }
      if(direction==1)
      {
        flagX = 0;
        flagY = 1;
      }
      startPt.Transform(Transform.Translation(flagX * delta, flagY * delta, 0));
      Point3d endPt = new Point3d(startPt);
      endPt.Transform(Transform.Translation(flagY * lengthOfLine, flagX * lengthOfLine, 0));
      Curve resultLine = new Line(startPt, endPt).ToNurbsCurve();
      resultLines.Add(resultLine);
    }
  }

  public void CreateColumns(List<Curve> verticleLines,List<Curve> horizontalLines,double heightOfColumn,double radiusOfColumn,bool isCircle,ref DataTree<Point3d> centerPts,ref DataTree<Brep> columns)
  {
    for (int i = 0; i < verticleLines.Count; i++)
    {
      for (int j = 0; j < horizontalLines.Count; j++)
      {
        CurveIntersections intersections = Intersection.CurveCurve(verticleLines[i], horizontalLines[j], 0.1, 0.1);
        for (int k = 0; k < intersections.Count; k++)
        {
          Point3d centerPt = intersections[k].PointA;
          centerPts.Add(centerPt, new GH_Path(i));

          Plane plane = new Plane(centerPt, Vector3d.XAxis, Vector3d.YAxis);
          Curve baseCurve;
          if (isCircle)
          {
            baseCurve = new Circle(centerPt, radiusOfColumn).ToNurbsCurve();
          }
          else
          {
            Interval edge = new Interval(-radiusOfColumn, radiusOfColumn);
            baseCurve = new Rectangle3d(plane, edge, edge).ToNurbsCurve();
          }
          Brep column = Surface.CreateExtrusion(baseCurve, new Vector3d(0, 0, heightOfColumn)).ToBrep().CapPlanarHoles(0.1);
          columns.Add(column, new GH_Path(i));
        }
      }
    }
  }
# ---------- end c_script ----------
scriptpar = ScriptParasite(Enable=Toggle(True), Folder="D:\软件\Rhino相关\KevinShopTest\13AxisNet")
